# Grasshopper definition rhinopython1.gh (Grasshopper 1.0.7)

path = FilePath("D:\GitHub\ironpythontest\Rhinoscript\ghSubDCurve.py")
path_2 = FilePath("D:\GitHub\ironpythontest\Rhinoscript\rhinoscript1.py")
file = ReadFile(File=path, PerLineParse=False)
pt = Point([Point(-17.61537268, -6.657846125, 0), Point(-11.53449176, 9.918075538, 0), Point(2.188359868, -5.27793785, 0), Point(10.5763052, 22.13724909, 0), Point(21.58062245, -1.077251766, 0)])
file_2 = ReadFile(File=path_2, PerLineParse=False)
pt_2 = Point([Point(-17.61537268, -6.657846125, 0), Point(-11.53449176, 9.918075538, 0), Point(2.188359868, -5.27793785, 0), Point(10.5763052, 22.13724909, 0), Point(21.58062245, -1.077251766, 0)])
pt_3 = Point([Point(-1.633669952, 9.613234149, 0), Point(18.2681732, 18.85069342, 0)])
pt_4 = Point(Point(15.41972214, -0.9677149543, 0))
pt_5 = Point(Point(23.03471975, 8.186128832, 0))
c_script = CSharpScript(controlPoints=pt, iterationCount=Slider(3, range=0..10))  # -> out, curve; inputs controlPoints: list of Point3d, iterationCount: Int32
# ---------- c_script: C# ----------
    
    for (int j = 0; j < iterationCount; j++)
    {
      List<Point3d> newControlPoints = new List<Point3d>();
      
      for (int i = 0; i < controlPoints.Count - 1; i++)
      {
        Point3d oneQuarterPoint = 0.75 * controlPoints[i] + 0.25 * controlPoints[i + 1];
        newControlPoints.Add(oneQuarterPoint);

        Point3d threeQuarterPoint = 0.25 * controlPoints[i] + 0.75 * controlPoints[i + 1];
        newControlPoints.Add(threeQuarterPoint);
      }

      controlPoints = newControlPoints;
    }

    curve = new PolylineCurve(controlPoints);
# ---------- end c_script ----------
python = GhPythonScript(Code=file_2)  # -> Out, A
python_2 = GhPythonScript(controlPoints=pt_2, iterationCount=Slider(2, range=0..10))  # -> out, curve; inputs controlPoints: list of Point3d, iterationCount: Int32
# ---------- python_2: Python ----------
    # for (int j = 0; j < iterationCount; j++)
    # {
    #   List<Point3d> newControlPoints = new List<Point3d>();

    #   for (int i = 0; i < controlPoints.Count - 1; i++)
    #   {
    #     Point3d oneQuarterPoint = 0.75 * controlPoints[i] + 0.25 * controlPoints[i + 1];
    #     newControlPoints.Add(oneQuarterPoint);

    #     Point3d threeQuarterPoint = 0.25 * controlPoints[i] + 0.75 * controlPoints[i + 1];
    #     newControlPoints.Add(threeQuarterPoint);
    #   }

    #   controlPoints = newControlPoints;
    # }

    # curve = new PolylineCurve(controlPoints);


import rhinoscriptsyntax as rs

for j in range(iterationCount):
    newControlPoints = []
    
    for i in range(len(controlPoints)-1):
        oneQuarterPoint = rs.PointAdd(rs.PointScale(controlPoints[i], 0.75),rs.PointScale(controlPoints[i+1], 0.25))   
        newControlPoints.append(rs.CreatePoint(oneQuarterPoint))
        
        threeQuarterPoint = rs.PointAdd(rs.PointScale(controlPoints[i], 0.25),rs.PointScale(controlPoints[i+1], 0.75))
        newControlPoints.append(rs.CreatePoint(threeQuarterPoint))
    
    controlPoints = newControlPoints

curve = rs.AddPolyline(controlPoints)
# ---------- end python_2 ----------
python_3 = GhPythonScript(x=pt_4, y=pt_5)  # -> out, a
# ---------- python_3: Python ----------
__author__ = "인시공현장PC"
__version__ = "2019.11.15"

import rhinoscriptsyntax as rs

newPoint = rs.PointAdd(rs.PointScale(x, 0.25),rs.PointScale(y, 0.75))

a = rs.CreatePoint(newPoint)
# ---------- end python_3 ----------
# for (int j = 0; j < iterationCount; j++)
#     {
#       List<Point3d> newControlPoints = new List<Point3d>();
# 
#       for (int i = 0; i < controlPoints.Count - 1; i++)
#       {
#         Point3d oneQuarterPoint = 0.75 * controlPoints[i] + 0.25 * controlPoints[i + 1];
#         newControlPoints.Add(oneQuarterPoint);
# 
#         Point3d threeQuarterPoint = 0.25 * controlPoints[i] + 0.75 * controlPoints[i + 1];
#         newControlPoints.Add(threeQuarterPoint);
#       }
# 
#       controlPoints = newControlPoints;
#     }
# 
#     curve = new PolylineCurve(controlPoints);
python_4 = GhPythonScript(x=pt_2)  # -> out, a; inputs x: list of Point3d
# ---------- python_4: Python ----------
__author__ = "인시공현장PC"
__version__ = "2019.11.15"

import rhinoscriptsyntax as rs

print len(x)
# ---------- end python_4 ----------
